# Grasshopper definition TestScript.gh (Grasshopper 1.0.7)

c_script = CSharpScript(
    run=Toggle(False),
    reset=Button(),
    Reference="C:\Users\nicol\source\repos\SharpMatter\SharpMatter\obj\Debug\SharpMatter.dll")  # -> out, A; inputs run: Boolean, reset: Boolean
# ---------- c_script: C# usings ----------
using SharpMatter.SharpGeometry;
using SharpMatter.SharpPhysics;
using SharpMatter.SharpForces;
# ---------- c_script: C# ----------
    List<Point3d> pos = new List<Point3d>();
    Random ran = new Random();

    double lifeSpan = 500;
    double lifeThreshold = 16;
    double lifeDecay = 1;
    Wind windForce = new Wind(new Vec3(0.2, 0.6, 0.2));




    if(run)
    {
      counter++;

      foreach (SharpParticle item in particles)
      {
        item.Update();
        Drag dragForce = new Drag(item);
        // item.AddForce(dragForce.DragForce);
        item.Life(item, lifeDecay);

        pos.Add((Point3d) item.position);


      }


      SharpParticle.Die(particles, lifeThreshold);

      if(counter == 100)
      {
        SharpParticle p = new SharpParticle(Vec3.Zero(),
          Vec3.Zero(), Vec3.Vector3dRandom(ran), 0.05, 0.05, 1, lifeSpan);
        SharpParticle p2 = new SharpParticle(new Vec3(2, 10, 0),
          Vec3.Zero(), Vec3.Vector3dRandom(ran), 0.05, 0.05, 1, lifeSpan);

        particles.Add(p);
        particles.Add(p2);
        counter = 0;
      }


      Component.ExpireSolution(true);
    }

    if(reset)
    {
      particles.Clear();
      counter = 0;

      // for (int i = 0; i < 70; i++)
      //  {
      //    SharpParticle p = new SharpParticle(Vec3.VectorRandomDistribution(0, 10, 0, 10, 0, 0, ran), Vec3.Zero(), Vec3.Vector3dRandom(ran), 0.05, 0.05, 1, lifeSpan);
      //    particles.Add(p);
      //  }

      SharpParticle p = new SharpParticle(Vec3.Zero(),
        Vec3.Zero(), Vec3.Vector3dRandom(ran), 0.05, 0.05, 1, lifeSpan);
      particles.Add(p);


    }

    A = pos;
# ---------- c_script: C# additional code ----------
  List<SharpParticle> particles = new List<SharpParticle>();
  int counter = 0;
# ---------- end c_script ----------
panel = Panel(c_script.out)
